# Grasshopper definition vortextrail.gh (Grasshopper 1.0.4)
# plug-ins: Kangaroo Components

# ---- group: Define axis of rotation
construct_point = ConstructPoint(XCoordinate=Slider(5, range=0..10), YCoordinate=Slider(5, range=0..10), ZCoordinate=0)
construct_point_2 = ConstructPoint(XCoordinate=Slider(5, range=0..10), YCoordinate=Slider(5, range=0..10), ZCoordinate=Slider(10, range=0..10))
line = Line(StartPoint=construct_point, EndPoint=construct_point_2)

# ---- group: Grid of Points
number_slider = Slider(10, range=0..10)
square = Square(Plane=PlaneXY(0, 0, 0), Size=1, ExtentX=number_slider, ExtentY=number_slider)  # -> Cells, flatten(Points)

# ---- group: Vortex Force and Falloff Slider
vortex = Vortex(
    AxisStart=construct_point,
    AxisEnd=construct_point_2,
    Point=square.Points,
    Strength=100,
    Cutoff=0,
    Exponent=Slider(-1.5, range=-10..0))

# ---- group: Core Kangaroo
boolean_toggle = BooleanToggle(True)
timer = Timer(TimerInterval=20, Target=kangaroophysics)  # disabled
kangaroophysics = KangarooPhysics(ForceObjects=vortex, Settings=null, Geometry=square.Points, SimulationReset=boolean_toggle)  # -> Out, Iterations, ParticlesOut, GeometryOut, KE

# ---- group: Visualize Path of Points
point = Point(kangaroophysics.GeometryOut)
trail = Trail(Points=point, Reset=boolean_toggle, Record=True)
