# Grasshopper definition voronoi.gh (Grasshopper 0.9.76)
# plug-ins: Weaverbird

# Right Click and Set Input Surface
# |
# |
# V
input_surface_to_tile = Surface(<surface referenced from the Rhino model>)

# ---- group: Options
max_offset_parameter = Slider(0.5, range=0..1)
min_offset_parameter = Slider(0.7, range=0..1)
voronoi_cell_count = Slider(100, range=0..1000)
mesh_thickness = Slider(0.5, range=0..1)

# ---- group: Generate Random Points on Surface
populate_geometry = PopulateGeometry(Geometry=input_surface_to_tile, Count=voronoi_cell_count, Seed=1)

# ---- group: Build Voronoi Cells
bounding_box = BoundingBox(Content=input_surface_to_tile, Plane=PlaneXY(0, 0, 0))  # -> Box, Box_2
voronoi_3d = Voronoi3D(Points=populate_geometry, Box=bounding_box.Box)  # -> Cells, Boundary

# ---- group: Intersect Surface with Voronoi Cells
brep_brep = BrepBrep(BrepA=input_surface_to_tile, BrepB=voronoi_3d.Cells)  # -> flatten(Curves), Points

# ---- group: Convert Curve Intersections into Polylines and Find Centers
discontinuity = Discontinuity(Curve=brep_brep.Curves, Level=1)  # -> Points, Parameters
average = Average(Input=discontinuity.Points)
polyline = PolyLine(Vertices=discontinuity.Points, Closed=True)

# ---- group: Remap Values for Offset Falloff
construct_domain = ConstructDomain(DomainStart=max_offset_parameter, DomainEnd=min_offset_parameter)
deconstruct_box = DeconstructBox(Box=bounding_box.Box)  # -> Plane, X, Y, Z
deconstruct = Deconstruct(Point=average)  # -> XComponent, YComponent, ZComponent
remap_numbers = RemapNumbers(Value=deconstruct.ZComponent, Source=deconstruct_box.Z, Target=construct_domain)  # -> Mapped, Clipped

# ---- group: Scale Voronoi Polylines Down to Offset Them
scale = Scale(Geometry=polyline, Center=average, Factor=remap_numbers.Mapped)  # -> Geometry, Transform

# ---- group: Loft Offset and Original Curve
loft = Loft(
    Curves=[polyline, scale.Geometry],
    Options={Adjust=False, Closed=False, LoftEnds=0, LoftSimp=0, LoftType=0, Rebuild=10, Refit=0.01})

# ---- group: Convert Each Lofted Surface into 1x1 Mesh
deconstruct_brep = DeconstructBrep(Brep=loft)  # -> Faces, Edges, Vertices
mesh_surface = MeshSurface(Surface=deconstruct_brep.Faces, UCount="1", VCount="1", Overhang=True, Equalize=False)  # -> flatten(Mesh)

# ---- group: Join Meshes
weaverbird_s_join_meshes_and_weld = WeaverbirdsJoinMeshesAndWeld(Mesh=flatten(mesh_surface), Weld=True)

# ---- group: Add Thickness to Mesh
weaverbird_s_mesh_thicken = WeaverbirdsMeshThicken(MeshCurves=weaverbird_s_join_meshes_and_weld, Distance=mesh_thickness, OffsetType=0)

# ---- group: 2 Step Smoothing
weaverbird_s_catmull_clark_subdivision = WeaverbirdsCatmullClarkSubdivision(MeshCurves=weaverbird_s_mesh_thicken, Level=Slider(3, range=0..10), SmoothNakedEdges=1)
weaverbird_s_laplacian_smoothing = WeaverbirdsLaplacianSmoothing(MeshCurves=weaverbird_s_catmull_clark_subdivision, Level=Slider(1, range=0..10), SmoothNakedEdges=1, Thin=1)

# ---- group: Add Color
mesh_colours = MeshColours(Mesh=weaverbird_s_laplacian_smoothing, Colours=ColourSwatch(SwatchColor=RGB(196, 141, 31)))

# ----
panel = Panel("""BAKE THIS
|
|
V""")

# ---- group: Solidness Check
volume = Volume(Geometry=mesh_colours)  # -> Volume, Centroid
panel_2 = Panel(volume.Volume)
