# Grasshopper definition data_example.gh (Grasshopper 0.9.76)

panel = Panel("Seeded Random Data")
panel_2 = Panel("Time-Indexed")
random = Random(Range=Domain(0, 1), Number=Slider(50, range=0..100), Seed=Slider(3, range=0..10))
panel_3 = Panel("3 Dimensional Path")
panel_4 = Panel("2D Matrix")
# Intensity of sunlight entering Zach’s apartment on from 12:01am to 11:59pm on 4/12/15.
panel_5 = Panel("""1.16
0.71
0.41
0.25
0.15
0.08
0.05
0.03
0.01
0.01
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""")
panel_6 = Panel("""51.5072759
51.0623551
50.9035305
53.3820287
33.8498458
39.2810502
46.0544459
50.4120332
34.9173073
53.2343427
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""")
# World’s 3000 Most Populous Cities Lat/Long
panel_7 = Panel("""-0.1276597
-1.3140919
-1.4041996
-1.4657174
-116.5378612
-76.567903
14.5046117
4.4436244
33.6373765
-0.5370209
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""")
panel_8 = Panel("""0.0
-0.722838
-1.430821
-2.12098
-2.789209
-3.429544
-4.032741
-4.583075
-5.04974
-5.356656
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""")
panel_9 = Panel("""0.0
0.113512
0.239295
0.379973
0.539213
0.722388
0.937907
1.200162
1.537309
2.016946
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""")
panel_10 = Panel("Motion Data")
panel_11 = Panel("""0.0
0.68163
1.376568
2.086421
2.813135
3.559069
4.326991
5.119679
5.937332
6.759373
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""")
panel_12 = Panel(random)
split_list = SplitList(List=panel_6, Index=1000)  # -> ListA, ListB
panel_13 = Panel(split_list.ListA)
