# Grasshopper definition data_form_sample.gh (Grasshopper 0.9.76)

# ---- group: Random Points
# Data to 3D Form Workshop
number_slider = Slider(100, range=0..1000)
number_slider_2 = Slider(3, range=0..10)
construct_domain = ConstructDomain(DomainStart=0, DomainEnd=100)
random = Random(Range=construct_domain, Number=number_slider, Seed=expr("x+5", number_slider_2))  # -> flatten(Random)
random_2 = Random(Range=construct_domain, Number=number_slider, Seed=expr("x+2", number_slider_2))  # -> flatten(Random)
random_3 = Random(Range=construct_domain, Number=number_slider, Seed=number_slider_2)  # -> flatten(Random)
construct_point = ConstructPoint(XCoordinate=random, YCoordinate=random_3, ZCoordinate=random_2)
cull_duplicates = CullDuplicates(Points=construct_point, Tolerance=0.1, CullMode=3)  # -> Points, Indices, Valence

# ----
number_slider_3 = Slider(0.5, range=0..10)
number_slider_4 = Slider(60, range=0..1000)
rectangular = Rectangular(Plane=PlaneXY(0, 0, 0), SizeX=number_slider_3, SizeY=number_slider_3, ExtentX=number_slider_4, ExtentY=number_slider_4)  # -> Cells, Points

# ---- group: Color Heightfields
deconstruct = Deconstruct(Point=rectangular.Points)  # -> XComponent, YComponent, ZComponent
deconstruct_2 = Deconstruct(Point=rectangular.Points)  # -> XComponent, YComponent, ZComponent
deconstruct_3 = Deconstruct(Point=rectangular.Points)  # -> XComponent, YComponent, ZComponent
construct_point_2 = ConstructPoint(XCoordinate=deconstruct.XComponent, YCoordinate=deconstruct.YComponent, ZCoordinate=expr("x*10", <missing>))
construct_point_3 = ConstructPoint(XCoordinate=deconstruct_3.XComponent, YCoordinate=deconstruct_3.YComponent, ZCoordinate=expr("x*10", <missing>))
construct_point_4 = ConstructPoint(XCoordinate=deconstruct_2.XComponent, YCoordinate=deconstruct_2.YComponent, ZCoordinate=expr("x*10", <missing>))
delaunay_mesh = DelaunayMesh(Points=flatten(construct_point_2), Plane=PlaneXY(0, 0, 0))
delaunay_mesh_2 = DelaunayMesh(Points=flatten(construct_point_3), Plane=PlaneXY(0, 0, 0))
delaunay_mesh_3 = DelaunayMesh(Points=flatten(construct_point_4), Plane=PlaneXY(0, 0, 0))
smooth_mesh = SmoothMesh(Mesh=delaunay_mesh, Strength=1, SkipNaked=True, Iterations=Slider(10, range=0..100))
smooth_mesh_2 = SmoothMesh(Mesh=delaunay_mesh_2, Strength=1, SkipNaked=True, Iterations=Slider(10, range=0..100))
smooth_mesh_3 = SmoothMesh(Mesh=delaunay_mesh_3, Strength=1, SkipNaked=True, Iterations=Slider(10, range=0..100))

# ---- group: Circle Field
circle_cnr = CircleCNR(Center=rectangular.Points, Normal=Vector(0, 0, 1), Radius=expr("x*.5", <missing>))

# ---- group: Implicit Histogram
weave = Weave(Pattern=[0, 1, 2], Stream0=flatten(<missing>), Stream1=flatten(<missing>), Stream2=flatten(<missing>), NullGaps=False)  # -> flatten(Weave)
numbers_to_points = NumbersToPoints(Numbers=flatten(weave), Mask=4)

# ----
point = Point(flatten(cull_duplicates.Points))

# ---- group: Relaxed Minimum Bounding Volume
point_2 = Point(point)
cull_duplicates_2 = CullDuplicates(Points=point_2, Tolerance=0.01, CullMode=3)  # -> Points, Indices, Valence
bounding_box = BoundingBox(Content=cull_duplicates_2.Points, Plane=PlaneXY(0, 0, 0), UnionBox=True)  # -> Box, Box_2
box_corners = BoxCorners(Box=bounding_box.Box)  # -> CornerA, CornerB, CornerC, CornerD, CornerE, CornerF, CornerG, CornerH
sphere_4pt = Sphere4Pt(Point1=box_corners.CornerA, Point2=box_corners.CornerG, Point3=box_corners.CornerD, Point4=box_corners.CornerF)  # -> Center, Radius, Sphere
mesh_brep = MeshBrep(
    Brep=sphere_4pt.Sphere,
    Settings={GridMaxCount=0, GridMinCount=16, JaggedSeams=False, MaxEdgeLength=0, MinEdgeLength=0.0001, MinTolerance=0, Refine=True, RefineAngle=0, RelativeTolerance=0.65, SimplePlanes=True, Tolerance=0})
deconstruct_mesh = DeconstructMesh(Mesh=mesh_brep)  # -> Vertices, Faces, Colours, Normals
closest_point = ClosestPoint(Point=deconstruct_mesh.Vertices, Cloud=point_2)  # -> ClosestPoint, CPIndex, Distance
construct_mesh = ConstructMesh(Vertices=closest_point.ClosestPoint, Faces=deconstruct_mesh.Faces)

# ---- group: Plotted Spheres
construct_domain_2 = ConstructDomain(DomainStart=Slider(0.001, range=0..1), DomainEnd=Slider(5.5, range=0..10))
random_4 = Random(Range=construct_domain_2, Number=653, Seed=2)
sphere = Sphere(Base=point, Radius=random_4)

# ---- group: Piped Curve [B-Spline]
nurbs_curve = NurbsCurve(Vertices=point, Degree=Slider(3, range=0..10), Periodic=False)  # -> Curve, Length, Domain
pipe = Pipe(Curve=nurbs_curve.Curve, Radius=Slider(0.093, range=0..1), Caps=0)

# ---- group: Piped Curve [Interp]
interpolate = Interpolate(Vertices=point, Degree=Slider(3, range=0..10), Periodic=False, KnotStyle=1)  # -> Curve, Length, Domain
pipe_2 = Pipe(Curve=interpolate.Curve, Radius=Slider(0.03, range=0..1), Caps=0)

# ---- group: Voronoi Volume
facet_dome = FacetDome(Points=point, Radius=Slider(100, range=0..100))  # -> Pattern, Dome
boundary_surfaces = BoundarySurfaces(Edges=facet_dome.Pattern)

# ---- group: Voronoi Cells
bounding_box_2 = BoundingBox(Content=point, Plane=PlaneXY(0, 0, 0), UnionBox=True)  # -> Box, Box_2
voronoi_3d = Voronoi3D(Points=point, Box=bounding_box_2.Box)  # -> Cells, Boundary

# ---- group: Delaunay Scaffold
delaunay_edges = DelaunayEdges(Points=point, Plane=PlaneXY(0, 0, 0))  # -> Connectivity, Edges
pipe_3 = Pipe(Curve=flatten(delaunay_edges.Edges), Radius=Slider(0.1, range=0..1), Caps=0)

# ---- group: Hulls
convex_hull = ConvexHull(Points=point, Plane=PlaneXY(0, 0, 0))  # -> Hull, HullZ, Indices
fragment_patch = FragmentPatch(Boundary=convex_hull.HullZ)
patch = Patch(Curves=convex_hull.HullZ, Spans=20, Flexibility=1, Trim=True)

# ---- group: Delaunay and Smoothed Delaunay Surface
xy_plane = XYPlane(Origin=Point(0, 0, 0))
delaunay_mesh_4 = DelaunayMesh(Points=point, Plane=xy_plane)
smooth_mesh_4 = SmoothMesh(Mesh=delaunay_mesh_4, Strength=Slider(1, range=0..1), SkipNaked=True, Iterations=Slider(12, range=0..100))
mesh = Mesh(delaunay_mesh_4)

# ---- group: Color Plotted Spheres
remap_numbers = RemapNumbers(Value=random, Source=Domain(0, 100), Target=Domain(0, 255))  # -> Mapped, Clipped
remap_numbers_2 = RemapNumbers(Value=random_3, Source=Domain(0, 100), Target=Domain(0, 255))  # -> Mapped, Clipped
remap_numbers_3 = RemapNumbers(Value=random_2, Source=Domain(0, 100), Target=Domain(0, 255))  # -> Mapped, Clipped
colour_rgb = ColourRGB(Alpha=255, Red=remap_numbers.Mapped, Green=remap_numbers_2.Mapped, Blue=remap_numbers_3.Mapped)

number_slider_5 = Slider(5.5, range=0..10)

construct_domain_3 = ConstructDomain(DomainStart=Slider(0.001, range=0..1), DomainEnd=number_slider_5)
random_5 = Random(Range=construct_domain_3, Number=653, Seed=2)
sphere_2 = Sphere(Base=point, Radius=random_5)

custom_preview = CustomPreview(Geometry=sphere_2, Shader=colour_rgb)
