# Grasshopper definition attractorpoint.gh (Grasshopper 0.9.76)

# ---- group: Draw grid of points
square = Square(Plane=PlaneXY(0, 0, 0), Size=Slider(1.41, range=0..10), ExtentX=Slider(10, range=0..10), ExtentY=Slider(10, range=0..10))  # -> Cells, flatten(Points)

# ---- group: Movable Attractor/Repulsor Point
construct_point = ConstructPoint(XCoordinate=Slider(4.4, range=0..10), YCoordinate=Slider(5.4, range=0..10), ZCoordinate=0)

# ----
grid = Point(square.Points)
distance = Distance(PointA=construct_point, PointB=grid)

# ---- group: Attractor
square_root = SquareRoot(Value=distance)
division = Division(A=Slider(0.48, range=0..10), B=square_root)

# ---- group: Create domain of max and min distances
sort_list = SortList(Keys=division)  # -> Keys, ValuesA
reverse_list = ReverseList(List=sort_list.Keys)
list_item = ListItem(List=sort_list.Keys, Index=0, Wrap=True)
list_item_2 = ListItem(List=reverse_list, Index=0, Wrap=True)
construct_domain = ConstructDomain(DomainStart=list_item, DomainEnd=list_item_2)

# ---- group: Repulsor
multiplication = Multiplication(A=distance, B=Slider(0.17, range=0..1))

# ---- group: Map distances to color values
remap_numbers = RemapNumbers(Value=division, Source=construct_domain, Target="255")  # -> Mapped, Clipped
colour_rgb = ColourRGB(Alpha=255, Red=expr("x", remap_numbers.Mapped), Green=0, Blue=remap_numbers.Mapped)

# ----
# <------
# Change the "Radius" input to 'Multiplication' for the opposite effect
circle = Circle(Plane=grid, Radius=division)

# ---- group: Draw spheres colored by distance from control point
boundary_surfaces = BoundarySurfaces(Edges=circle)
custom_preview = CustomPreview(Geometry=boundary_surfaces, Shader=colour_rgb)
