# Grasshopper definition closest_point_walker.gh (Grasshopper 0.9.76)

# ---- group: Draw Point Grid
square = Square(Plane=PlaneXY(0, 0, 0), Size=Slider(1.9, range=0..10), ExtentX=Slider(8, range=0..10), ExtentY=Slider(5, range=0..10))  # -> Cells, flatten(Points)

# ---- group: Point for Evaluation
construct_point = ConstructPoint(XCoordinate=Slider(10, range=0..10), YCoordinate=Slider(5.3, range=0..10), ZCoordinate=0)

# ----
point = Point(square.Points)

# ---- group: Sort Points by Distance
distance = Distance(PointA=construct_point, PointB=point)
sort_list = SortList(Keys=distance, ValuesValuesA=point)  # -> Keys, ValuesValuesA

# ---- group: Create domain of max and min distances
reverse_list = ReverseList(List=sort_list.Keys)
list_item = ListItem(List=sort_list.Keys, Index=0, Wrap=True)
list_item_2 = ListItem(List=reverse_list, Index=0, Wrap=True)
construct_domain = ConstructDomain(DomainStart=list_item, DomainEnd=list_item_2)

# ---- group: Find N Closest Points
split_list = SplitList(List=sort_list.ValuesValuesA, Index=Slider(12, range=0..100))  # -> ListA, ListB

# ---- group: Map distances to color values
remap_numbers = RemapNumbers(Value=distance, Source=construct_domain, Target="255")  # -> Mapped, Clipped
colour_rgb = ColourRGB(Alpha=255, Red=expr("255-x", remap_numbers.Mapped), Green=0, Blue=remap_numbers.Mapped)

# ---- group: Draw spheres colored by distance from control point
sphere = Sphere(Base=square.Points, Radius=Slider(0.3, range=0..1))
custom_preview = CustomPreview(Geometry=sphere, Shader=colour_rgb)

# ---- group: Draw Lines to Close Points and Draw Boundary Polygon
line = Line(StartPoint=construct_point, EndPoint=split_list.ListA)
convex_hull = ConvexHull(Points=split_list.ListA, Plane=PlaneXY(0, 0, 0))  # -> Hull, HullZ, Indices
curve = Curve([convex_hull.Hull, line])
