# Grasshopper definition waterfall.gh (Grasshopper 0.9.76)

# ---- group: Waterfall Boundary
construct_point = ConstructPoint(XCoordinate=3, YCoordinate=5, ZCoordinate=0)
construct_point_2 = ConstructPoint(XCoordinate=0, YCoordinate=0, ZCoordinate=0)
rectangle_2pt = Rectangle2Pt(Plane=PlaneXY(0, 0, 0), PointA=construct_point_2, PointB=construct_point, Radius=0)  # -> Rectangle, Length

# ---- group: Grab Top of Bounding Rectangle
explode = Explode(Curve=rectangle_2pt.Rectangle, Recursive=True)  # -> Segments, Vertices
list_item = ListItem(List=explode.Segments, Index=2, Wrap=True)
unit_y = UnitY(Factor=Slider(-0.008, range=-1..0))
move = Move(Geometry=list_item, Motion=unit_y)  # -> Geometry, Transform

# ---- group: Water Emmitters
divide_curve = DivideCurve(Curve=move.Geometry, Count=Slider(40, range=0..100), Kinks=False)  # -> Points, Tangents, Parameters

# ---- group: Random Whirlpools
populate_2d = Populate2D(Region=rectangle_2pt.Rectangle, Count=Slider(7, range=0..10), Seed=156)

# ---- group: Log in Stream
construct_point_3 = ConstructPoint(XCoordinate=Slider(1, range=0..3), YCoordinate=Slider(1.4, range=0..5), ZCoordinate=0)
construct_point_4 = ConstructPoint(XCoordinate=Slider(0.1, range=0..3), YCoordinate=Slider(2.7, range=0..5), ZCoordinate=0)
line = Line(StartPoint=construct_point_3, EndPoint=construct_point_4)
line_charge = LineCharge(Line=line, Charge=1, Bounds=rectangle_2pt.Rectangle)

# ---- group: Random Rocks
populate_2d_2 = Populate2D(Region=rectangle_2pt.Rectangle, Count=Slider(7, range=0..10), Seed=1)

# ---- group: Gravity
unit_y_2 = UnitY(Factor=1)
negative = Negative(Value=unit_y_2)
line_sdl = LineSDL(Start=divide_curve.Points, Direction=negative, Length=1)
vector_force = VectorForce(Line=line_sdl, Bounds=rectangle_2pt.Rectangle)

# ---- group: Rocks in Stream
number_slider = Slider(2.2, range=0..10)
point_charge = PointCharge(Point=populate_2d_2, Charge=Slider(1, range=-1..1), Decay=number_slider, Bounds=rectangle_2pt.Rectangle)

# ---- group: Whirlpools
number_slider_2 = Slider(1.512, range=0..10)
spin_force = SpinForce(
    Plane=populate_2d,
    Strength=Slider(55, range=0..100),
    Radius=number_slider_2,
    Decay=Slider(1.9, range=0..10),
    Bounds=rectangle_2pt.Rectangle)

# ---- group: Preview whirlpools as circles and rocks as pentagons
polygon = Polygon(Plane=populate_2d_2, Radius=expr(".08*x", number_slider), Segments=6, FilletRadius=0)  # -> Polygon, Length
circle = Circle(Plane=populate_2d, Radius=expr(".08*x", number_slider_2))

# ----
merge_fields = MergeFields(Fields=flatten([point_charge, vector_force, spin_force, line_charge]))
field_line = FieldLine(Field=merge_fields, Point=divide_curve.Points, Steps=1000, Accuracy=0.1, Method=2)

# ---- group: Draw Prettier Lines
discontinuity = Discontinuity(Curve=field_line, Level=1)  # -> Points, Parameters
interpolate = Interpolate(Vertices=discontinuity.Points, Degree=3, Periodic=False, KnotStyle=1)  # -> Curve, Length, Domain

# ----
panel = Panel("""Bake This
|
|
V""")
unit_z = UnitZ(Factor=1)
extrude = Extrude(Base=interpolate.Curve, Direction=unit_z)
custom_preview = CustomPreview(Geometry=extrude, Shader=graft(ColourSwatch(SwatchColor=RGB(4, 96, 112))))
