# Grasshopper definition basicphysics.gh (Grasshopper 0.9.76)
# plug-ins: Kangaroo Components

construct_point = ConstructPoint(XCoordinate=0, YCoordinate=0, ZCoordinate=Slider(20, range=0..100))

# ---- group: Draw Ball
number_slider = Slider(10, range=0..10)
mesh_sphere = MeshSphere(Base=construct_point, Radius=Slider(2, range=0..10), UCount=number_slider, VCount=number_slider)

# ---- group: Forces
meshpressure = MeshPressure(M=mesh_sphere, pressurelevel=Slider(100, range=0..100))
springsfrommesh = SpringsFromMesh(M=mesh_sphere, stiffness=1000, B=Slider(1.5, range=0..10))
gravity = Gravity(M=mesh_sphere, F=-9.8)

# ----
kangaroo_settings = KangarooSettings(
    Tolerance=0.001,
    TimeStep=0.01,
    SubIterations=10,
    Floor=Toggle(True),
    Drag=1,
    Restitution=0.7,
    StaticFriction=10,
    KineticFriction=10,
    Settle=2,
    Tumble=1,
    Sound=False,
    Solver=0)
timer = Timer(TimerInterval=20, Target=kangaroophysics)  # disabled
kangaroophysics = KangarooPhysics(
    ForceObjects=flatten([gravity, meshpressure, springsfrommesh]),
    Settings=kangaroo_settings,
    Geometry=mesh_sphere,
    SimulationReset=Toggle(True))  # -> Out, Iterations, ParticlesOut, GeometryOut, KE
custom_preview = CustomPreview(Geometry=kangaroophysics.GeometryOut, Shader=ColourSwatch(SwatchColor=RGB(95, 217, 97)))

# ==== cluster Gravity: Apply gravity to vertices of a mesh
M = ClusterInput()
F = ClusterInput()
mcomp = Decompose(Mesh=M)  # -> Vertices, Faces, Colours, Normals
Z = UnitZ(Factor=F)
duppt = RemoveDuplicatePts(Points=mcomp.Vertices, Tolerance=0.01)
uforce = UnaryForce(Point=duppt, Force=Z)
U = ClusterOutput(uforce)

# ==== cluster MeshPressure: Applies pressure to a triangulated mesh
M = ClusterInput()
mcomp = Decompose(Mesh=M)  # -> Vertices, Faces, Colours, Normals
vertices = FaceVertices(Face=mcomp.Faces)  # -> CornerA, CornerB, CornerC, CornerD
item = ListItem(List=mcomp.Vertices, Index=vertices.CornerA, Wrap=False)
item_2 = ListItem(List=mcomp.Vertices, Index=vertices.CornerB, Wrap=False)
item_3 = ListItem(List=mcomp.Vertices, Index=vertices.CornerC, Wrap=False)
pressurelevel = ClusterInput()
pressure = Pressure(Point1=item, Point2=item_2, Point3=item_3, PressureLevel=pressurelevel)
P = ClusterOutput(pressure)

# ==== cluster SpringsFromMesh: Turns all edges of a mesh into springs
M = ClusterInput()
medges = MeshEdges(Mesh=M)  # -> NakedEdges, InteriorEdges, NonManifoldEdges
crv = Curve([medges.NakedEdges, medges.InteriorEdges])
B = ClusterInput()
len = Length(Curve=crv)
multiplication = Multiplication(A=len, B=B)
stiffness = ClusterInput()
springs = SpringsFromLine(Connection=crv, Stiffness=stiffness, Damping=10, RestLength=multiplication, UpperCutoff=0, LowerCutoff=0, Plasticity=0)
S = ClusterOutput(springs)
