# Grasshopper definition lakeglass.gh (Grasshopper 0.9.76)

lake_qinghai_china = Panel("4186,32.8,5810,3.2")
lake_maracaibo_venezuela = Panel("13210,60,8900,4.2")
# Data Model: Surface Area in KM2, Max Depth in M, Contaminants per Meter2, Conservation Investment in Millions USD
lake_michigan_usa = Panel("58030,281, 28180, 43.2 ")
lake_victoria_kenya_tanzania_uganda = Panel("68800, 83, 18010, 7.2")
lake_baikal_russia = Panel("31722, 1642, 36000, 24.6")
text_split = TextSplit(Text=lake_michigan_usa, Separators=",")
list_item = ListItem(List=text_split, Index=3, Wrap=True)
list_item_2 = ListItem(List=text_split, Index=1, Wrap=True)
list_item_3 = ListItem(List=text_split, Index=2, Wrap=True)
list_item_4 = ListItem(List=text_split, Index=0, Wrap=True)
division = Division(A=list_item, B="100")
division_2 = Division(A=list_item, B="10")
division_3 = Division(A=list_item_3, B="10000")
division_4 = Division(A=list_item_2, B="50")
division_5 = Division(A=list_item_4, B="10000")

# ---- group: Draw Bottom Edge of Glass
construct_point = ConstructPoint(XCoordinate=0, YCoordinate=0, ZCoordinate=0)
unit_x = UnitX(Factor=1)
line_sdl = LineSDL(Start=construct_point, Direction=unit_x, Length=division_2)

# ---- group: Draw Foot Curve
end_points = EndPoints(Curve=line_sdl)  # -> Start, End
construct_point_2 = ConstructPoint(XCoordinate=division, YCoordinate=0, ZCoordinate=division_2)
unit_z = UnitZ(Factor=1)  # -> expr("-x", UnitVector)
unit_z_2 = UnitZ(Factor=1)
bezier_span = BezierSpan(StartPoint=end_points.End, StartTangent=unit_z_2, EndPoint=construct_point_2, EndTangent=unit_z)  # -> Curve, Length, Domain

# ---- group: Draw Stem
unit_z_3 = UnitZ(Factor=1)
line_sdl_2 = LineSDL(Start=construct_point_2, Direction=unit_z_3, Length=division_3)

# ---- group: Find Bowl Upper Point
end_points_2 = EndPoints(Curve=line_sdl_2)  # -> Start, End
deconstruct = Deconstruct(Point=end_points_2.End)  # -> XComponent, YComponent, ZComponent
addition = Addition(A=deconstruct.ZComponent, B=division_4)
construct_point_3 = ConstructPoint(XCoordinate=division_5, YCoordinate=0, ZCoordinate=addition)

# ---- group: Draw Bowl Curve
division_6 = Division(A=division_4, B=2)
unit_z_4 = UnitZ(Factor=division_6)  # -> expr("-x", UnitVector)
unit_z_5 = UnitZ(Factor=division_6)
bezier_span_2 = BezierSpan(StartPoint=end_points_2.End, StartTangent=unit_z_5, EndPoint=construct_point_3, EndTangent=unit_z_4)  # -> Curve, Length, Domain

# ----
join_curves = JoinCurves(Curves=flatten([bezier_span_2.Curve, line_sdl_2, bezier_span.Curve, line_sdl]), Preserve=False)

# ---- group: Draw Revolution Axis
construct_point_4 = ConstructPoint(XCoordinate=0, YCoordinate=0, ZCoordinate=0)
line_sdl_3 = LineSDL(Start=construct_point_4, Direction=Vector(0, 0, 1), Length=1)

# ----
panel = Panel("Bake This")
revolution = Revolution(Curve=join_curves, Axis=line_sdl_3, Domain=Domain(0, 6.283185307))
colour_picker = ColourPicker(PickedColour=RGB(65, 118, 128))
custom_preview = CustomPreview(Geometry=revolution, Shader=colour_picker)
