# Grasshopper definition meshdeform.gh (Grasshopper 1.0.4)

# ---- group: Import mesh and extract vertices
mesh = Mesh(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)
deconstruct_mesh = DeconstructMesh(Mesh=mesh)  # -> Vertices, Faces, Colours, Normals

# ----
construct_point = ConstructPoint(XCoordinate=0, YCoordinate=0, ZCoordinate=Slider(4.05, range=0..10))
construct_point_2 = ConstructPoint(XCoordinate=0, YCoordinate=0, ZCoordinate=Slider(2.34, range=0..10))
construct_point_3 = ConstructPoint(XCoordinate=Slider(0.6, range=0..10), YCoordinate=0, ZCoordinate=Slider(0.86, range=0..10))

closest_points = ClosestPoints(Point=construct_point_2, Cloud=deconstruct_mesh.Vertices, Count=Slider(1000, range=0..1000))  # -> ClosestPoint, CPIndex, Distance
list_item = ListItem(List=deconstruct_mesh.Vertices, Index=closest_points.CPIndex, Wrap=True)

# ---- group: Find n closest points to each control point
closest_points_2 = ClosestPoints(Point=construct_point, Cloud=deconstruct_mesh.Vertices, Count=Slider(1000, range=0..1000))  # -> ClosestPoint, CPIndex, Distance
list_item_2 = ListItem(List=deconstruct_mesh.Vertices, Index=closest_points_2.CPIndex, Wrap=True)

# ----
closest_points_3 = ClosestPoints(Point=construct_point_3, Cloud=deconstruct_mesh.Vertices, Count=Slider(917, range=0..2000))  # -> ClosestPoint, CPIndex, Distance
list_item_3 = ListItem(List=deconstruct_mesh.Vertices, Index=closest_points_3.CPIndex, Wrap=True)

# ---- group: Calculate direction to each mesh point from nearby control point
vector_2pt = Vector2Pt(PointA=construct_point, PointB=list_item_2, Unitize=False)  # -> Vector, Length

# ----
vector_2pt_2 = Vector2Pt(PointA=construct_point_2, PointB=list_item, Unitize=False)  # -> Vector, Length
vector_2pt_3 = Vector2Pt(PointA=construct_point_3, PointB=list_item_3, Unitize=False)  # -> Vector, Length

gradient_remap = GradientRemap(value=vector_2pt_2.Length, target=Slider(0.4, range=0..1))

# ---- group: Calculate how far to push nearby vertoces
# Your Data Would Replace the Sliders Here
gradient_remap_2 = GradientRemap(value=vector_2pt.Length, target=Slider(0.45, range=0..1))

# ----
gradient_remap_3 = GradientRemap(value=vector_2pt_3.Length, target=Slider(0.28, range=0..1))

# ---- group: Push nearby vertices away from control point with falloff
amplitude = Amplitude(Vector=vector_2pt.Vector, Amplitude=gradient_remap_2)
move = Move(Geometry=closest_points_2.ClosestPoint, Motion=amplitude)  # -> Geometry, Transform

# ----
amplitude_2 = Amplitude(Vector=vector_2pt_3.Vector, Amplitude=gradient_remap_3)
move_2 = Move(Geometry=closest_points_3.ClosestPoint, Motion=amplitude_2)  # -> Geometry, Transform

amplitude_3 = Amplitude(Vector=vector_2pt_2.Vector, Amplitude=gradient_remap)
move_3 = Move(Geometry=closest_points.ClosestPoint, Motion=amplitude_3)  # -> Geometry, Transform

# ---- group: Replace original vertices with moved vertices, in sequence
replace_items = ReplaceItems(List=deconstruct_mesh.Vertices, Item=move.Geometry, Indices=closest_points_2.CPIndex, Wrap=False)

# ----
replace_items_2 = ReplaceItems(List=replace_items, Item=move_3.Geometry, Indices=closest_points.CPIndex, Wrap=False)
replace_items_3 = ReplaceItems(List=replace_items_2, Item=move_2.Geometry, Indices=closest_points_3.CPIndex, Wrap=False)

# ---- group: Preview original mesh next to deformed model
unit_x = UnitX(Factor=Slider(5, range=0..10))
move_4 = Move(Geometry=mesh, Motion=unit_x)  # -> Geometry, Transform

# ----
panel = Panel("Bake This!")

# ---- group: Rebuild Mesh
construct_mesh = ConstructMesh(Vertices=replace_items_3, Faces=deconstruct_mesh.Faces)

# ==== cluster GradientRemap
value = ClusterInput()
sort_list = SortList(Keys=value)  # -> Keys, ValuesValuesA
reverse_list = ReverseList(List=sort_list.Keys)
list_item = ListItem(List=sort_list.Keys, Index=0, Wrap=True)
list_item_2 = ListItem(List=reverse_list, Index=0, Wrap=True)
construct_domain = ConstructDomain(DomainStart=list_item_2, DomainEnd=list_item)
target = ClusterInput()
remap_numbers = RemapNumbers(Value=value, Source=construct_domain, Target=target)  # -> Mapped, Clipped
mapped = ClusterOutput(remap_numbers.Mapped)
