# Grasshopper definition prop.gh (Grasshopper 0.8.61)

pt = Point(graft([<point referenced from the Rhino model> x4]))
mesh = Mesh(<mesh referenced from the Rhino model>)
crv = Curve([<curve referenced from the Rhino model> x19])
pt_2 = Point(<point referenced from the Rhino model>)
pt_3 = Point(<point referenced from the Rhino model>)
explode = MeshExplode(Mesh=mesh, Interpolate=False)
mcomp = Decompose(Mesh=explode)  # -> Vertices, Faces, Colours, Normals
vortex = Vortex(AxisStart=pt_2, AxisEnd=pt_3, Point=pt, Strength=-150, Cutoff=0, Exponent=0)
springs = SpringsFromLine(Connection=crv, Stiffness=4000, Damping=10, RestLength=crv, Cutoff=0, CompressionFail=0, TensileFail=0, Plasticity=0)
flip = FlipMatrix(Data=mcomp.Vertices)
vec = Vector(Vector(0, 0, 0))
pt_4 = Point(graft([<point referenced from the Rhino model> x2]))
bang = ExplodeTree(Tree=flip)  # -> Branch0, Branch1, Branch2
Z = UnitZ(Factor=-55)
line = Line(crv)
wind = Wind(
    Point1=bang.Branch0,
    Point2=bang.Branch1,
    Point3=bang.Branch2,
    Wind=vec,
    Relative=True,
    Strength=Slider(0.1, range=0..1),
    Waterline=0)
uforce = UnaryForce(Point=pt_4, Force=Z)
timer = Timer(TimerInterval=20, Target=kangaroo)  # disabled
kangaroo = KangarooPhysics(
    ForceObjects=flatten([vortex, springs, wind, uforce]),
    Settings=null,
    Geometry=[mesh, line],
    SimulationReset=Toggle(True))  # -> Out, Iterations, ParticlesOut, GeometryOut
